% Simulink data dictionary plane_sm_dictionary.sldd

D_sm = 0.4
H_sm = 0.2
katWyrzutni = 8
katAlfaWyrzutni = 2
Pitch0 = 10
Roll0 = 0
Yaw0 = 130
xg0 = 0
yg0 = 0
zg0 = 0
Vx0 = 0
Vy0 = 0
Vz0 = 0

poch = struct(
  alfa=[-1.698; -0.244; 1.345; 2.935; 4.528; 6.149; 7.863],
  betaH=[0.474; -2.238; -4.782; -7.113; -8.679; -10.254; -12.265],
  CL=[0.1; 0.2; 0.3; 0.4; 0.5; 0.6011; 0.702],
  CD=[0.01359; 0.01552; 0.01865; 0.02288; 0.02809; 0.03454; 0.04342],
  Cm=[-0; -1.0e-5; 0; 2.0e-5; 1.0e-5; -0; -1.0e-5],
  CL_a=[0.0804; 0.0815; 0.0808; 0.08213; 0.0811; 0.07842; 0.07333],
  CD_a=[0.00046; 0.00136; 0.00225; 0.00291; 0.00366; 0.00474; 0.00559],
  CD_aa=[0.0011; 0.00076; 0.00053; 0.00055; 0.0006; 0.00069; 0.00055],
  Cm_a=[-0.01144; -0.01232; -0.01377; -0.01528; -0.01524; -0.01459; -0.0132],
  Cl_b=[-0.00203; -0.00226; -0.00237; -0.00245; -0.00262; -0.00295; -0.00314],
  Cn_b=[0.00084; 0.0007; 0.00054; 0.00045; 0.00036; 0.00026; 0.00019],
  Cl_p=[-0.51094; -0.51804; -0.5283; -0.5201; -0.49886; -0.48421; -0.46908],
  Cn_p=[0.05629; 0.02928; -0.00207; -0.03368; -0.06318; -0.09068; -0.1176],
  Cm_q=[-0.5143; -0.46318; -0.44767; -0.4593; -0.51376; -0.52422; -0.47012],
  Cl_r=[0.0681; 0.07112; 0.07587; 0.07722; 0.08236; 0.09736; 0.1096],
  Cn_r=[-0.03315; -0.03096; -0.02803; -0.027; -0.02657; -0.0262; -0.02611],
  CL_bh=[0.01317; 0.0133; 0.01375; 0.01443; 0.0156; 0.016; 0.01475],
  CD_bh=[6.0e-5; -2.0e-5; -6.0e-5; -5.0e-5; 1.0e-5; 4.0e-5; 0.00015],
  CD_bbh=[7.0e-5; 6.0e-5; 7.0e-5; 7.0e-5; 8.0e-5; 0.0001; 0.00012],
  Cm_bh=[-0.00881; -0.01061; -0.0109; -0.01136; -0.01233; -0.01267; -0.01174],
  CY_ba=[-0.00175; -0.00063; -0.00029; -0.00017; -0.0001; -5.0e-5; -1.0e-5],
  Cl_ba=[-0.00487; -0.002; -0.00127; -0.00099; -0.00091; -0.00082; -0.00064],
  Cn_ba=[0.00047; 0.00013; 2.0e-5; -2.0e-5; -4.0e-5; -6.0e-5; -7.0e-5],
  CL_q=[0.8295; 0.7316; 0.7055; 0.7168; 0.7844; 0.79; 0.793])

a_PWM2n = -0.006856667
b_PWM2n = 1.966167
c_PWM2n = 0
a_JP2CT = -0.7583
b_JP2CT = 0.9858
Ct0 = 0.91
Sref_sp = 3.463606
Cx_sp = 3.310116
t_otw = 0.6
t_flak = 0.6
a_sp = 5.772677
b_sp = -3.140185e-16
SimulationData = Simulink.Signal(DataType="Bus: simulationData")

simulationData = Simulink.Bus()
  IAS: double
  Fx: double
  Fy: double
  Fz: double
  Mx: double
  My: double
  Mz: double
  Alfa: double
  Beta: double
  Cxa: double
  Cy: double
  Cza: double
  Cl: double
  Cm: double
  Cn: double
  p: double
  q: double
  r: double
  rho: double
  DelA: double
  DelH: double
  DelV: double
  DelF: double
  ThrottleMotorN: double

model_data = Simulink.Bus()
  gpsSAcc: single
  gpsVAcc: single
  gpsHAcc: single
  gpsNumOfSat: uint8
  newDataGPS: uint8
  gpsFix: uint8
  pitch: single
  roll: single
  yaw: single
  gyro: single[3 1], Unit="deg"
  accel: single[3 1], Unit="mss"
  newDateAero: uint8
  pressure: single, Unit="hPa"
  temperature: single
  newDataMag: uint8
  mag: single[3 1], Unit="gauss"
  gpsPosNE: int32[2 1]
  gpsPosD: single
  gpsVelNED: single[3 1]
  airSpeed: single
  dynamicPressure: single
  trueAirspeed: single
  fuelConsumptionTotal: single
  fuelConsumptionAct: single

MODEL_DATA = Simulink.Signal(DataType="Bus: model_data")
g = 9.81
m = 6.67
Ix = 0.810078
Iy = 1.177574
Iz = 1.346181

pochodne = struct(
  Sref=0.721,
  Bref=2.43,
  Cref=0.2977,
  Alfa=[-4.7996 -3.6294 -2.4405 -0.6616 1.1757 3.6605 8.1745],
  DelH=[1.7257 1.1631 0.3246 -1.3611 -3.518 -7.682 -17.5727],
  DelF1=repmat(0, 1, 7),
  V=[32.4832 26.5224 22.9691 19.5881 17.363 15.3127 13.2612],
  qinf=[646.28444787 430.85559233 323.14247732 235.01236774 184.65268351 143.61825354 107.71389808],
  Re=[0.662 0.541 0.468 0.399 0.354 0.312 0.27],
  CL=[0.200017 0.30001 0.399996 0.550002 0.700004 0.899994 1.199979],
  CD=[0.030143 0.032297 0.035154 0.04005 0.049659 0.066517 0.103005],
  CZ=[0.19679354 0.29736381 0.39813627 0.54950288 0.70087556 0.90240463 1.20243286],
  CX=[0.0467729 0.05122365 0.0521547 0.04639812 0.03528559 0.00892179 -0.06866468],
  Cm=[-1.1e-5 -3.0e-6 2.0e-6 3.0e-6 -5.0e-6 4.0e-6 -2.2e-5],
  dCL_dAlfa=[5.37950074 5.34363358 5.25597104 5.30513082 5.18068438 4.98312854 2.98808949],
  dCD_dAlfa=[0.04847223 0.08754795 0.13430131 0.25404949 0.32566921 0.41390471 0.50259858],
  dCZ_dAlfa=[5.3565815 5.32737425 5.24548497 5.30184367 5.18627593 4.99938777 3.02919304],
  dCX_dAlfa=[0.49840985 0.4256384 0.35798863 0.31529006 0.21930132 0.09491581 0.07262028],
  dCm_dAlfa=[-1.21707695 -1.15107221 -1.29270738 -1.27918557 -1.35367009 -1.24916258 -1.26428867],
  dXsa_c=[22.62434764 21.54100189 24.59502475 24.11223432 26.12917496 25.06783792 42.31093726],
  dCY_dBeta=[-0.28074932 -0.28315574 -0.2864789 -0.29197929 -0.29988611 -0.29301062 -0.31077231],
  dCl_dBeta=[-0.0047693 -0.0087525 -0.01535985 -0.0223591 -0.03189312 -0.04176977 -0.05816324],
  dCnP_dBeta=[0.0668298 0.06745432 0.06870795 0.07046808 0.07351392 0.0712347 0.0781927],
  dCnPV_dBeta=[0.06696158 0.0676159 0.06902193 0.07055402 0.07343371 0.07136648 0.08325764],
  dCL_dDelH=[0.50534878 0.46237694 0.44249531 0.40611249 0.35317118 0.35775485 0.28120769],
  dCD_dDelH=[-0.016272 -0.00968299 -0.00360963 0.00292208 -0.00017189 0.00108862 0.00658901],
  dCZ_dDelH=[0.50493823 0.46206255 0.44224766 0.40605167 0.35309331 0.35709448 0.27928739],
  dCX_dDelH=[0.02606804 0.01960611 0.01523592 0.00761121 -0.00741836 -0.02175422 -0.03346241],
  dCm_dDelH=[-1.34312766 -1.23168737 -1.17691261 -1.08117136 -0.93993726 -0.94583873 -0.76048688],
  dCY_dDelA=[0.01856383 0.01913679 0.01993893 0.0190222 0.02028271 0.02154321 0.01948057],
  dCl_dDelA=[-0.25155712 -0.24604756 -0.24298338 -0.21498637 -0.21287445 -0.20680912 -0.1711276],
  dCnP_dDelA=[0.02570289 0.02261694 0.01989882 0.01434686 0.0111234 0.0067334 0.00041826],
  dCnPV_dDelA=[0.02415017 0.02086369 0.01844924 0.01398017 0.01124602 0.0073648 0.00250956],
  dCY_dDelV=[0.1411768 0.14163517 0.14323945 0.14472914 0.14587505 0.14415618 0.14415618],
  dCl_dDelV=[0.00379413 0.00371506 0.00341712 0.00354203 0.00361078 0.00364057 0.00367495],
  dCnP_dDelV=[-0.04629384 -0.04645542 -0.04701577 -0.04760019 -0.04811241 -0.04755893 -0.04780645],
  dCnPV_dDelV=[-0.04629728 -0.04646688 -0.04701119 -0.047583 -0.04806314 -0.04751195 -0.04779499],
  dCY_dP=[0.05179969 0.05819988 0.06539966 0.07919969 0.08800079 0.10400019 0.10779977],
  dCl_dP=[-0.51770493 -0.51315491 -0.50883533 -0.54103791 -0.50120649 -0.5003089 -0.39650716],
  dCnP_dP=[0.00562197 -0.01097798 -0.02708786 -0.04902581 -0.07703069 -0.1104882 -0.15984966],
  dCnPV_dP=[0.00421598 -0.01453597 -0.03017184 -0.04688782 -0.07290265 -0.10556619 -0.14891968],
  dCL_dQ=[10.09649922 10.35950875 10.48499489 10.01099479 9.86802822 10.04603006 7.74200654],
  dCD_dQ=[-0.13949999 -0.05250004 0.06099997 0.25099987 0.43200124 0.60600181 0.66600056],
  dCZ_dQ=[10.07276736 10.34205488 10.4728873 10.00742913 9.87481473 10.06422463 7.7580423],
  dCX_dQ=[0.70577222 0.60338935 0.50741545 0.36657851 0.22943418 -0.03661652 -0.44158987],
  dCm_dQ=[-14.2114989 -15.02801269 -15.46749246 -14.66649236 -14.29904089 -15.11904523 -11.55000976],
  dCY_dR=[0.19070011 0.1903996 0.19190076 0.19349925 0.19639936 0.19010034 0.19209959],
  dCl_dR=[0.11730107 0.13035372 0.14254957 0.16250537 0.18272741 0.20875738 0.26624244],
  dCnP_dR=[-0.06744104 -0.06691886 -0.06684227 -0.06686274 -0.06712878 -0.06374512 -0.06236287],
  dCnPV_dR=[-0.07117704 -0.07061385 -0.07065928 -0.06998773 -0.07053577 -0.06771912 -0.06688786],
  FH0=[4.248e-5 2.532e-5 1.249e-5 -6.95e-6 -7.068e-5 -0.00014148 -0.00018388],
  FA0=repmat(-0, 1, 7),
  FV0=repmat(-0, 1, 7),
  sH0=[-1.7257 -1.1631 -0.3246 1.3611 3.518 7.682 17.5727],
  sA0=repmat(0, 1, 7),
  sV0=repmat(0, 1, 7),
  sHdH=repmat(-57.29577951, 1, 7),
  sAdA=repmat(-57.29577951, 1, 7),
  sVdV=repmat(-57.29577951, 1, 7),
  dFF_dAlfa=repmat(0, 1, 7),
  dFH_dAlfa=[0.00066004 0.00062451 0.00085911 0.0003357 -0.00031077 0.00017556 0.00050877],
  dFA_dBeta=[1.375e-5 2.406e-5 3.667e-5 4.011e-5 6.188e-5 8.48e-5 0.00010886],
  dFV_dBeta=[-0.00012948 -0.00012567 -0.00012322 -0.00011756 -0.00011392 -9.749e-5 -7.781e-5],
  dFH_dDelH=[0.00144005 0.00129428 0.00121836 0.00121704 0.00133041 0.00098885 0.00086755],
  dFA_dDelA=[0.0013556 0.00115963 0.00115278 0.00092589 0.00096028 0.0009775 0.00088233],
  dFV_dDelA=[7.16e-6 6.85e-6 6.62e-6 5.56e-6 5.18e-6 4.75e-6 2.85e-6],
  dFV_dDelV=[0.00035646 0.00035766 0.00036073 0.00036153 0.0003622 0.00036031 0.0003545],
  dFA_dP=[-0.000102 -0.00018199 -0.000124 -0.00038199 2.0e-5 -1.4e-5 0.00033199],
  dFV_dP=[-2.3e-5 -2.177e-5 -2.052e-5 -1.953e-5 -1.687e-5 -1.58e-5 -8.29e-6],
  dFF_dQ=repmat(0, 1, 7),
  dFH_dQ=[-0.00443595 -0.00652581 -0.00712733 -0.0001372 0.00389501 -0.0023081 -0.00317291],
  dFA_dR=[0.000325 0.00033899 0.000335 0.000338 0.000342 0.00033901 0.00038499],
  dFV_dR=[-0.00011989 -0.00011689 -0.00011613 -0.00011234 -0.00010975 -9.974e-5 -8.592e-5],
  dCL_dAp=repmat(0, 1, 7),
  dCm_dAp=repmat(0, 1, 7),
  dFH_dDelF=repmat(0, 1, 7),
  dCD_dDelF=repmat(0, 1, 7),
  dCL_dDelF=repmat(0, 1, 7),
  dCm_dDelF=repmat(0, 1, 7))

Sref = 0.721
bref = 2.43
cref = 0.2977

integratorStruct = Simulink.Bus()
  u_prev: double
  y_prev: double

p_mem = Simulink.Signal(DataType="Bus: integratorStruct")
q_mem = Simulink.Signal(DataType="Bus: integratorStruct")
r_mem = Simulink.Signal(DataType="Bus: integratorStruct")
roll_mem = Simulink.Signal(DataType="Bus: integratorStruct")
pitch_mem = Simulink.Signal(DataType="Bus: integratorStruct")
yaw_mem = Simulink.Signal(DataType="Bus: integratorStruct")
vx_mem = Simulink.Signal(DataType="Bus: integratorStruct")
vy_mem = Simulink.Signal(DataType="Bus: integratorStruct")
vz_mem = Simulink.Signal(DataType="Bus: integratorStruct")
xg_mem = Simulink.Signal(DataType="Bus: integratorStruct")
yg_mem = Simulink.Signal(DataType="Bus: integratorStruct")
zg_mem = Simulink.Signal(DataType="Bus: integratorStruct")